% Simulink data dictionary PMSM_NFLUX.sldd

PWM_HalfPeriod = single(8000)
Tpwm = single(16000)
J = single(7.5e-5)
B = single(8.0e-5)
load_torque = single(0)
i_alpha = Simulink.Signal(DataType="single")
i_beta = Simulink.Signal(DataType="single")
u_alpha = Simulink.Signal(DataType="single")
u_beta = Simulink.Signal(DataType="single")
FluxWm = Simulink.Signal(StorageClass="ExportedGlobal", DataType="single")
FluxTheta = Simulink.Signal(StorageClass="ExportedGlobal", DataType="single")
Ts = Simulink.Parameter(0.0001, DataType="single")
Rs = Simulink.Parameter(single(6.97), StorageClass="Struct", StructName="motor")
L = Simulink.Parameter(single(0.00535), StorageClass="Struct", StructName="motor")
flux = Simulink.Parameter(single(0.016884), StorageClass="Struct", StructName="motor")
Udc = Simulink.Parameter(single(24))
curr_d_kp = Simulink.Parameter(single(0.017), StorageClass="Struct", StructName="curr_kpki")
curr_d_ki = Simulink.Parameter(single(35), StorageClass="Struct", StructName="curr_kpki")
curr_q_kp = Simulink.Parameter(single(0.017), StorageClass="Struct", StructName="curr_kpki")
curr_q_ki = Simulink.Parameter(single(35), StorageClass="Struct", StructName="curr_kpki")
spd_kp = Simulink.Parameter(single(0.001550577), StorageClass="Struct", StructName="spd_kpki")
spd_ki = Simulink.Parameter(single(0.00165394868), StorageClass="Struct", StructName="spd_kpki")
Gamma = Simulink.Parameter(single(100000), StorageClass="Struct", StructName="nflux_obs")
PLL_Kp = Simulink.Parameter(single(212.1), StorageClass="Struct", StructName="nflux_obs")
PLL_Ki = Simulink.Parameter(single(2500), StorageClass="Struct", StructName="nflux_obs")
LPF_K = Simulink.Parameter(single(0.003), StorageClass="Struct", StructName="nflux_obs")
iq_handover = Simulink.Parameter(single(0.4), StorageClass="Struct", StructName="handover_cfg")
iq_ref_slew_up = Simulink.Parameter(single(5), StorageClass="Struct", StructName="handover_cfg")
iq_ref_slew_down = Simulink.Parameter(single(2), StorageClass="Struct", StructName="handover_cfg")
theta_handover_slew_limit = Simulink.Parameter(single(5), StorageClass="Struct", StructName="handover_cfg")
Pn = Simulink.Parameter(single(4), StorageClass="Struct", StructName="motor")
PLL_OmegaLimit = Simulink.Parameter(single(6283.18555))
RsId_Init = Simulink.Parameter(single(6.97))
RsId_L = Simulink.Parameter(single(0.00535))
RsId_MinCurrent = Simulink.Parameter(single(0.05))
RsId_MaxOmega = Simulink.Parameter(single(5))
RsId_LpfGain = Simulink.Parameter(single(0.02))
RsId_Min = Simulink.Parameter(single(0.1))
RsId_Max = Simulink.Parameter(single(50))
RsIdBatch_Init = single(6.97)
RsIdBatch_MinCurrent = single(0.05)
RsIdBatch_MaxSpeed = single(5)
RsIdBatch_MinSamples = int32(3)
RsIdBatch_MinLevels = int32(4)
RsIdBatch_SettleTicks = int32(200)
RsIdBatch_Min = single(0.1)
RsIdBatch_Max = single(50)
RsIdBatch_MaxRmse = single(0.1)
RsIdBatch_MaxValRmse = single(0.1)
RsIdBatch_RefTemp = single(20)
RsIdBatch_CuAlpha = single(0.00393)